# Grasshopper definition twistedTowerJuliettaTester_02.gh (Grasshopper 1.0.8)
# plug-ins: RhinoCodePluginGH

number_slider = Slider(72, range=0..100)
number_slider_2 = Slider(28, range=0..100)
Z = UnitZ(Factor=1)
multiplication = Multiplication(A=number_slider_2, B=-1)
dom = ConstructDomain(DomainStart=multiplication, DomainEnd=number_slider_2)
dom_2 = ConstructDomain(DomainStart=0, DomainEnd=number_slider)
line = LineSDL(Start="0,0,0", Direction=Z, Length=number_slider)
rad = Radians(Degrees=Slider(-34, range=-90..90))
box = DomainBox(Base=PlaneXY(0, 0, 0), X=dom, Y=dom, Z=dom_2)
taper = Taper(
    Geometry=box,
    Axis=line,
    Start=Slider(0.391, range=0..1),
    End=Slider(0.305, range=0..1),
    Flat=False,
    Infinite=False,
    Rigid=False)
number_slider_3 = Slider(1.5, range=1..3)
number_slider_4 = Slider(2.31, range=1..3)
twist = Twist(Geometry=taper, Axis=line, Angle=rad, Infinite=False, Rigid=False)
volume = Volume(Geometry=twist)  # -> Volume, Centroid
scale = Scale(Geometry=twist, Center=volume.Centroid, Factor=Slider(0.85, range=0..1))  # -> Geometry, Transform
bbox = BoundingBox(Content=twist, Plane=PlaneXY(0, 0, 0))  # -> Box, Box_2
scale_nu = ScaleNU(
    Geometry=bbox.Box,
    Plane=PlaneXY(0, 0, 0),
    ScaleX=number_slider_3,
    ScaleY=number_slider_3,
    ScaleZ=Slider(1.36, range=1..3))  # -> Geometry, Transform
box_2 = Box(scale_nu.Geometry)
X = UnitX(Factor=1)
timestep = Slider(0.2, range=0..1)
panel = Panel("C:\Users\bhowes\OneDrive - Thornton Tomasetti, Inc\Desktop\Julietta\test02.json")
c_script = CSharpScript(
    B=box_2,
    M=scale.Geometry,
    R="96,96,64",
    dt=timestep,
    duration=Slider(1, range=1..30),
    nu=Slider(0.01, range=0..0.01),
    U=X,
    Path=panel)  # -> out, OK, File, Voxels; inputs B: Box, M: list of Mesh, R: Vector3d, dt: Double, duration: Double, nu: Double, U: Vector3d, Path: String
# ---------- c_script: C# ----------
// Grasshopper Script Instance
#region Usings
using System;
using System.Linq;
using System.Collections;
using System.Collections.Generic;
using System.Drawing;
using System.IO;
using System.Runtime.Serialization;
using System.Runtime.Serialization.Json;
using System.Text;
using System.Threading.Tasks;

using Rhino;
using Rhino.Geometry;

using Grasshopper;
using Grasshopper.Kernel;
using Grasshopper.Kernel.Data;
using Grasshopper.Kernel.Types;
#endregion

public class Script_Instance : GH_ScriptInstance
{
    #region Notes
    /* 
      Members:
        RhinoDoc RhinoDocument
        GH_Document GrasshopperDocument
        IGH_Component Component
        int Iteration

      Methods (Virtual & overridable):
        Print(string text)
        Print(string format, params object[] args)
        Reflect(object obj)
        Reflect(object obj, string method_name)
    */
    #endregion

    // ---------- POCOs for JSON ----------
  [DataContract]
  class DomainSpec {
    [DataMember] public double[] min;
    [DataMember] public double[] max;
    [DataMember] public int[]    resolution;
    [DataMember] public string   units;
    [DataMember] public string   axis_order;
  }
  [DataContract]
  class TimeSpec {
    [DataMember] public double dt;
    [DataMember] public double duration;
    [DataMember(EmitDefaultValue=false)] public int warmup_steps;
  }
  [DataContract]
  class ForcingSpec {
    [DataMember] public string type;
    [DataMember] public double[] velocity;
  }
  [DataContract]
  class FluidSpec {
    [DataMember] public double nu;
    [DataMember] public double rho;
    [DataMember] public ForcingSpec forcing;
  }
  [DataContract]
  class ObstaclesSpec {
    [DataMember] public string encoding;
    [DataMember] public int[]  shape;
    [DataMember] public int    inside_is;
    [DataMember] public string data;       // base64
  }
  [DataContract]
  class RootSpec {
    [DataMember] public string version;
    [DataMember] public DomainSpec domain;
    [DataMember] public TimeSpec time;
    [DataMember] public FluidSpec fluid;
    [DataMember] public ObstaclesSpec obstacles;
    [DataMember(EmitDefaultValue=false)] public string notes;
  }

    // ---------- Helpers ----------
  static string ToJson<T>(T obj) {
    var ser = new DataContractJsonSerializer(typeof(T));
    using (var ms = new MemoryStream()) {
      ser.WriteObject(ms, obj);
      return Encoding.UTF8.GetString(ms.ToArray());
    }
  }

  static byte[] Base64Mask(bool[,,] mask, int nx, int ny, int nz) {
    // Flatten x-fast (i fastest), then y (j), then z (k)
    var bytes = new byte[nx*ny*nz];
    int idx = 0;
    for (int k=0; k<nz; k++)
      for (int j=0; j<ny; j++)
        for (int i=0; i<nx; i++)
          bytes[idx++] = mask[i,j,k] ? (byte)1 : (byte)0;
    return bytes;
  }

  static bool IsInsideAnyMesh(Point3d p, List<Mesh> meshes, double tol) {
    for (int mi = 0; mi < meshes.Count; mi++) {
      var m = meshes[mi];
      if (!m.IsClosed) continue;
      var bb = m.GetBoundingBox(true);
      if (!bb.Contains(p)) continue;
      if (m.IsPointInside(p, tol, false)) return true;
    }
    return false;
  }

    private void RunScript(
	Box B,
	List<Mesh> M,
	Vector3d R,
	double dt,
	double duration,
	double nu,
	Vector3d U,
	string Path,
	ref object OK,
	ref object File,
	ref object Voxels)
    {
        if (!B.IsValid) { OK = false; File = "Invalid Box"; return; }
  if (M == null) M = new List<Mesh>();

  // --- resolution ---
  int nx = Math.Max(2, (int)R.X);
  int ny = Math.Max(2, (int)R.Y);
  int nz = Math.Max(2, (int)R.Z);

  // --- world AABB + cell metrics (used only for sampling) ---
  var bb = B.BoundingBox;
  double x0 = bb.Min.X, x1 = bb.Max.X;
  double y0 = bb.Min.Y, y1 = bb.Max.Y;
  double z0 = bb.Min.Z, z1 = bb.Max.Z;
  double dx = (x1 - x0) / nx, dy = (y1 - y0) / ny, dz = (z1 - z0) / nz;
  double tol = 0.5 * Math.Min(dx, Math.Min(dy, dz));

  // --- prefilter meshes by intersection with the box ---
  var meshes = new List<Mesh>();
  foreach (var m in M)
  {
    if (m == null) continue;
    if (!m.IsClosed) continue;
    meshes.Add(m);
  }

  // --- voxelize to a single x-fast byte buffer (0=fluid, 1=solid) ---
  var bytes = new byte[nx * ny * nz]; // <-- keep this single definition
  int idx = 0;                         // flatten index: k*nx*ny + j*nx + i

  for (int k = 0; k < nz; k++)
  {
    double zc = z0 + (k + 0.5) * dz;   // sample at cell centers
    for (int j = 0; j < ny; j++)
    {
      double yc = y0 + (j + 0.5) * dy;
      for (int i = 0; i < nx; i++, idx++)
      {
        double xc = x0 + (i + 0.5) * dx;
        var p = new Point3d(xc, yc, zc);

        bool inside = false;
        foreach (var m in meshes)
        {
          if (!m.GetBoundingBox(true).Contains(p)) continue;
          if (m.IsPointInside(p, tol, false)) { inside = true; break; }
        }

        bytes[idx] = inside ? (byte)1 : (byte)0;
      }
    }
  }

  // --- build JSON (domain in GRID units to match Julia identity sampling) ---
  var domain = new DomainSpec {
    min = new[]{ 0.0, 0.0, 0.0 },
    max = new[]{ (double)nx, (double)ny, (double)nz },
    resolution = new[]{ nx, ny, nz },
    units = "grid",                          // keep your field; value clarifies intent
    axis_order = "x-fast (row-major)"
  };

  var time = new TimeSpec { dt = dt, duration = duration, warmup_steps = 20 };

  var fluid = new FluidSpec {
    nu = nu,
    rho = 1.0,
    forcing = new ForcingSpec {
      type = "uniform_wind",
      velocity = new[]{ U.X, U.Y, U.Z }
    }
  };

  string b64 = Convert.ToBase64String(bytes);   // <-- use the voxel buffer we just built
  var obs = new ObstaclesSpec {
    encoding = "mask_uint8_base64",
    shape = new[]{ nx, ny, nz },
    inside_is = 1,
    data = b64
  };

  var root = new RootSpec {
    version = "1.0",
    domain = domain,
    time = time,
    fluid = fluid,
    obstacles = obs,
    notes = "Generated by GH C# voxelizer (grid-domain)"
  };

  string json = ToJson(root);
  try
  {
    var dir = System.IO.Path.GetDirectoryName(Path);
    if (!string.IsNullOrEmpty(dir)) System.IO.Directory.CreateDirectory(dir);
    System.IO.File.WriteAllText(Path, json);

    OK = true;
    File = Path;
    Voxels = nx * ny * nz;    // report voxel count (was 'total' before)
  }
  catch (Exception ex)
  {
    OK = false;
    File = ex.Message;
    Voxels = 0;
  }
    }
}
# ---------- end c_script ----------
